% Simulink data dictionary params.sldd

Ts = Simulink.Parameter(0.001, DataType="double")
iamax = Simulink.Parameter(10, StorageClass="Struct", Alias="maxCurrent", StructName="controlParams", DataType="single")
maxdelta = Simulink.Parameter(Simulink.data.Expression(ExpressionString="20/180*pi"), StorageClass="Struct", Alias="maxSteer", StructName="controlParams", DataType="single")
phi0 = Simulink.Parameter(0.1, StorageClass="Struct", Alias="rollSmall", StructName="controlParams", DataType="single")
phisat = Simulink.Parameter(0.5, StorageClass="Struct", Alias="rollSaturation", StructName="controlParams", DataType="single")
V0 = Simulink.Parameter(0.1, StorageClass="Struct", Alias="speedSmall", StructName="controlParams", DataType="single")
g = Simulink.Parameter(9.806, StorageClass="Struct", Alias="gravity", StructName="controlParams", DataType="single")
descr = {"Proportional control", "$\\mathcal H_2$ control", "$\\mathcal H_\\infty$ control"}
Kgain = Simulink.Parameter(1, StorageClass="Struct", Alias="controlTuningGain", StructName="controlParams", DataType="single")
Ktf = {struct(tf(num={[0 4.294895]}, den={[1 -0.8282042]}, Ts=0.001)), struct(tf(num={[0 0.9416917 -1.881492 0.9397997]}, den={[1 -2.951319 2.902785 -0.9514665]}, Ts=0.001)), struct(tf(num={[-1.984702 12.5554 -19.15698 8.586288]}, den={[1 -2.828359 2.656727 -0.8283678]}, Ts=0.001))}

Ksys = {struct(ss(a=0.8282042, b=1.866558, c=2.300971, d=0, Ts=0.001)), struct(
  ss(
    a=[0.9545644 0 0; 0 0.9968535 0; 0 0 0.9999009],
    b=[-1.137488; 0.4018895; 0.05896495],
    c=[-0.8519462 -0.06297417 -0.03524163],
    d=0,
    Ts=0.001)), struct(
  ss(
    a=[0.828411 0 0; 0 0.9999739 2.139651e-05; 0 -2.139651e-05 0.9999739],
    b=[3.735443; -0.06447129; 0.1639098],
    c=[1.859398 0.02067605 -0.01462701],
    d=-1.984702,
    Ts=0.001))}

kctrl = 1
vmin = Simulink.Parameter(1, StorageClass="Struct", Alias="speedMinCtrl", StructName="controlParams", DataType="single")
Kphidot = Simulink.Parameter(20, StorageClass="Struct", Alias="RollRateGain", StructName="controlParams")